# Grasshopper definition AttrRepulsion2.gh (Grasshopper 1.0.7)

# ---- group: Length
point1move = Slider(67, range=0..350)
number_slider = Slider(0.04, range=0..0.04)
pt = Point(<point referenced from the Rhino model>)

# ----
sizey = Slider(20, range=0..20)
sizex = Slider(20, range=0..20)
extentx = Slider(20, range=0..20)
extenty = Slider(20, range=0..20)

# ---- group: Height
number_slider_2 = Slider(0.09, range=0..0.09)
pt_2 = Point(<point referenced from the Rhino model>)
point2move = Slider(350, range=0..350)

# ---- group: Width
number_slider_3 = Slider(0.02, range=0..0.02)
point2move_2 = Slider(67, range=0..350)
pt_3 = Point(<point referenced from the Rhino model>)

# ----
X = UnitX(Factor=point1move)
X_2 = UnitX(Factor=point2move_2)
recgrid = Rectangular(Plane=PlaneXY(0, 0, 0), SizeX=sizex, SizeY=sizey, ExtentX=extentx, ExtentY=extenty)  # -> Cells, Points
Y = UnitY(Factor=point2move)
move = Move(Geometry=pt, Motion=X)  # -> Geometry, Transform
dist = Distance(PointA=recgrid.Points, PointB=move.Geometry)
multiplication = Multiplication(A=dist, B=number_slider)
move_2 = Move(Geometry=pt_3, Motion=X_2)  # -> Geometry, Transform
dist_2 = Distance(PointA=recgrid.Points, PointB=move_2.Geometry)
multiplication_2 = Multiplication(A=dist_2, B=number_slider_3)
move_3 = Move(Geometry=pt_2, Motion=Y)  # -> Geometry, Transform
dist_3 = Distance(PointA=recgrid.Points, PointB=move_3.Geometry)
multiplication_3 = Multiplication(A=dist_3, B=number_slider_2)
box = CenterBox(Base=recgrid.Points, X=multiplication, Y=multiplication_2, Z=multiplication_3)
group = Group(Objects=box)
