# Grasshopper definition IntroToData.gh (Grasshopper 1.0.7)

height = Slider(6.76, range=0..20)
parameter = Slider(0.08, range=0..1)
count = Slider(24, range=0..50)
crv = Curve(<curve referenced from the Rhino model>)
crv_2 = Curve(<curve referenced from the Rhino model>)

divide = DivideCurve(Curve=crv_2, Count=count, Kinks=False)  # -> Points, Tangents, Parameters
divide_2 = DivideCurve(Curve=crv, Count=count, Kinks=False)  # -> Points, Tangents, Parameters
ln = Line(StartPoint=divide.Points, EndPoint=divide_2.Points)
eval = EvaluateCurve(Curve=ln, Parameter=parameter)  # -> Point, Tangent, Angle
pdecon = Deconstruct(Point=eval.Point)  # -> XComponent, YComponent, ZComponent
addition = Addition(A=pdecon.ZComponent, B=height)
pt = ConstructPoint(XCoordinate=pdecon.XComponent, YCoordinate=pdecon.YComponent, ZCoordinate=addition)
pt_2 = Point(divide.Points)
pt_3 = Point(pt)
pt_4 = Point(divide_2.Points)
graft = GraftTree(Tree=pt_3, IncludeEmptyLists=True, IncludeNullItems=True)
graft_2 = GraftTree(Tree=pt_2, IncludeEmptyLists=True, IncludeNullItems=True)
graft_3 = GraftTree(Tree=pt_4, IncludeEmptyLists=True, IncludeNullItems=True)
panel = Panel(graft_2)
intcrv = Interpolate(Vertices=[graft_2, graft, graft_3], Degree=3, Periodic=False, KnotStyle=1)  # -> Curve, Length, Domain
panel_2 = Panel(graft)
flatten = FlattenTree(Tree=intcrv.Curve, Path="{0}")
loft = Loft(Curves=flatten, Options={Adjust=False, Closed=False, LoftEnds=0, LoftSimp=0, LoftType=0, Rebuild=10, Refit=0.01})
panel_3 = Panel(graft_3)
