# Grasshopper definition Door2D.gh (Grasshopper 1.0.7)

# ---- group: Sample Input Parameters
doorrotationangle_a = Slider(90, range=0..90)
framelength = Slider(150, range=0..200)
framewidth = Slider(40, range=0..40)
doorwidth_w = Slider(732, range=600..900)
wallangle = Slider(90, range=0..360)
rightopen = BooleanToggle(True)
point = Point(<point referenced from the Rhino model>)

# ----
door2d = Door2D(
    origin=point,
    fwidth=framewidth,
    fdepth=framelength,
    width=doorwidth_w,
    flip=rightopen,
    sangle=doorrotationangle_a,
    rotation=wallangle)

# ==== cluster Door2D: Creates a 2D drawing of a standard door.
width = ClusterInput()  # Width of the door.
origin = ClusterInput()
fwidth = ClusterInput()
fdepth = ClusterInput()
flip = ClusterInput()
sangle = ClusterInput()  # Door shutter Angle
rotation = ClusterInput()
number = Number(fwidth)
num = Number(width)
radians = Radians(Degrees=rotation)
num_2 = Number(number)
division = Division(A=num_2, B=Slider(2, range=0..10))
multiplication = Multiplication(A=division, B=2)
panel = Panel([division, multiplication])

# ---- group: Door Frames
deconstruct = Deconstruct(Point=origin)  # -> XComponent, YComponent, ZComponent
rectangle = Rectangle(Plane=origin, XSize=number, YSize=fdepth, Radius=0)  # -> Rectangle, Length

# ---- group: Left Swing
expression = Expression(y=deconstruct.YComponent, FrameLength=fdepth, Expression="y +(FrameLength)")
expression_2 = Expression(x=deconstruct.XComponent, FrameWidth=number, Expression="x+(FrameWidth)")
construct_point = ConstructPoint(XCoordinate=expression_2, YCoordinate=expression, ZCoordinate=deconstruct.ZComponent)

# ----
expression_3 = Expression(x=deconstruct.XComponent, doorwidth=num, Expression="x+(doorwidth/2)")

# ---- group: Door Frames (continued)
mirroring_point = ConstructPoint(XCoordinate=expression_3, YCoordinate=deconstruct.YComponent, ZCoordinate=deconstruct.ZComponent)
yz_plane = YZPlane(Origin=mirroring_point)
mirror = Mirror(Geometry=rectangle.Rectangle, Plane=yz_plane)  # -> Geometry, Transform
deconstruct_plane = DeconstructPlane(Plane=mirror.Geometry)  # -> Origin, XAxis, YAxis, ZAxis
deconstruct_2 = Deconstruct(Point=deconstruct_plane.Origin)  # -> XComponent, YComponent, ZComponent

# ---- group: Right Swing
expression_4 = Expression(x=deconstruct_2.XComponent, FrameWidth=number, Expression="x-(FrameWidth)")
expression_5 = Expression(y=deconstruct_2.YComponent, FrameLength=fdepth, Expression="y +(FrameLength)")
construct_point_2 = ConstructPoint(XCoordinate=expression_4, YCoordinate=expression_5, ZCoordinate=deconstruct.ZComponent)

# ---- group: DoorShutters
expression_6 = Expression(w=num, Framewidth=number, Expression="w-(2*Framewidth)")
multiplication_2 = Multiplication(A=number, B=0.75)
radians_2 = Radians(Degrees=sangle)
rectangle_2 = Rectangle(Plane=construct_point, XSize=expression_6, YSize=multiplication_2, Radius=0)  # -> Rectangle, Length
rotate = Rotate(Geometry=rectangle_2.Rectangle, Angle=radians_2, Plane=construct_point)  # -> Geometry, Transform

# ---- group: Arc
expression_7 = Expression(DoorWidth=num, FrameWidth=number, Expression="DoorWidth- (2*FrameWidth)")
deconstruct_plane_2 = DeconstructPlane(Plane=rotate.Geometry)  # -> Origin, XAxis, YAxis, ZAxis
arc = Arc(Plane=deconstruct_plane_2.Origin, Radius=expression_7, Angle=radians_2)  # -> Arc, Length

# ---- group: Opening Side
integer = Integer(flip)
panel_2 = Panel(integer)
stream_gate = StreamGate(Stream=[arc.Arc, rotate.Geometry, rectangle.Rectangle, mirror.Geometry], Gate=panel_2)  # -> Target0, Target1
mirror_2 = Mirror(Geometry=stream_gate.Target1, Plane=yz_plane)  # -> Geometry, Transform
group = Group(Objects=mirror_2.Geometry)

# ----
group_2 = Group(Objects=stream_gate.Target0)
stream_filter = StreamFilter(Gate=panel_2, Stream0=group_2, Stream1=group)
rotate_2 = Rotate(Geometry=stream_filter, Angle=radians, Plane=origin)  # -> Geometry, Transform
ungroup = Ungroup(Group=rotate_2.Geometry)
item = ListItem(List=ungroup, Index=0, Wrap=True)
dash = DashPattern(Curve=item, Pattern=panel)  # -> Dashes, Gaps
group_3 = Group(Objects=dash.Dashes)
replace = ReplaceItems(List=ungroup, Item=group_3, Indices=0, Wrap=False)
geometry = ClusterOutput(replace)
preview = CustomPreview(Geometry=replace, Material=ColourSwatch(SwatchColor=RGB(0, 0, 0)))
