# Grasshopper definition ParametricBench.gh (Grasshopper 1.0.7)

brep = Brep(<brep referenced from the Rhino model>)

# ---- group: Points for Pipe
deconstruct_brep = DeconstructBrep(Brep=brep)  # -> Faces, Edges, Vertices
point = Point(<point referenced from the Rhino model>)
xz_plane = XZPlane(Origin=point)
md_slider = MDSlider(
    SliderMode=0,
    slider_value=Point(0.2739638387, 0.6556810585, 0.5),
    x_domain=Domain(0, 1),
    y_domain=Domain(0, 1),
    z_domain=Domain(0, 1))
list_item = ListItem(List=deconstruct_brep.Faces, Index=Slider(4, range=0..10), Wrap=True)
evaluate_surface = EvaluateSurface(Surface=reparameterize(list_item), Point=md_slider)  # -> Point, Normal, UDirection, VDirection, Frame
point_2 = Point(evaluate_surface.Point)
mirror = Mirror(Geometry=point_2, Plane=xz_plane)  # -> Geometry, Transform

# ----
bounding_box = BoundingBox(Content=brep, Plane=PlaneXY(0, 0, 0))  # -> Box, Box_2
deconstruct_brep_2 = DeconstructBrep(Brep=bounding_box.Box)  # -> Faces, Edges, Vertices
list_item_2 = ListItem(List=deconstruct_brep_2.Edges, Index=0, Wrap=True)
perp_frames = PerpFrames(Curve=list_item_2, Count=Slider(18, range=0..100), Align=True)  # -> Frames, Parameters
brep_plane = BrepPlane(Brep=brep, Plane=perp_frames.Frames)  # -> Curves, Points
fillet = Fillet(Curve=brep_plane.Curves, Radius=Slider(2, range=0..10))
unit_x = UnitX(Factor=1)
length = Length(Curve=list_item_2)
point_3 = Point([point_2, mirror.Geometry])
pipe_radius = Slider(2, range=0..2)
line_sdl = LineSDL(Start=point_3, Direction=unit_x, Length=length)
pipe = Pipe(Curve=line_sdl, Radius=pipe_radius, Caps=0)
custom_preview = CustomPreview(Geometry=pipe, Material=ColourSwatch(SwatchColor=RGB(102, 102, 102)))
brep_plane_2 = BrepPlane(Brep=pipe, Plane=perp_frames.Frames)  # -> simplify(Curves), Points
curve = Curve(simplify(fillet))
unit_x_2 = UnitX(Factor=Slider(7.4, range=0..9))
boundary_surfaces = BoundarySurfaces(Edges=[brep_plane_2.Curves, curve])
move = Move(Geometry=boundary_surfaces, Motion=expr("x/2", unit_x_2))  # -> Geometry, Transform
extrude = Extrude(Base=move.Geometry, Direction=expr("-x", unit_x_2))
group = Group(Objects=flatten([pipe, extrude]))
custom_preview_2 = CustomPreview(Geometry=extrude, Material=ColourSwatch(SwatchColor=RGB(232, 215, 181)))
