# Grasshopper definition ParametricStairs.gh (Grasshopper 1.0.7)

curve = Curve([<curve referenced from the Rhino model> x2])
loft = Loft(Curves=curve, Options={Adjust=False, Closed=False, LoftEnds=0, LoftSimp=0, LoftType=0, Rebuild=10, Refit=0.01})
list_item = ListItem(List=curve, Index=0, Wrap=True)  # -> Item, Item1
treadwidth = Slider(4.33, range=0..50)
unit_y = UnitY(Factor=1)
point_on_curve = PointOnCurve(list_item.Item1, parameter=0)
riserheight = Slider(3, range=0..50)
contour = Contour(Shape=loft, Point=point_on_curve, Direction=unit_y, Distance=treadwidth)  # -> simplify(Contours)
xz_plane = XZPlane(Origin=Point(0, 0, 0))
offset_curve = OffsetCurve(Curve=contour, Distance=riserheight, Plane=xz_plane, Corners=1)  # -> simplify(Curve)
unit_y_2 = UnitY(Factor=treadwidth)
loft_2 = Loft(
    Curves=[offset_curve, contour],
    Options={Adjust=False, Closed=False, LoftEnds=0, LoftSimp=0, LoftType=0, Rebuild=10, Refit=0.01})
extrude = Extrude(Base=loft_2, Direction=unit_y_2)
custom_preview = CustomPreview(Geometry=extrude, Material=ColourSwatch(SwatchColor=RGB(40, 168, 158)))
