# Grasshopper definition ParametricTower.gh (Grasshopper 1.0.7)

floorheight = Slider(12, range=0..100)
floorcount = Slider(13, range=0..100)
floorcount_2 = Slider(15.512, range=0..20)

pt = ConstructPoint(XCoordinate=0, YCoordinate=0, ZCoordinate=Slider(0, range=0..50))
series = Series(Start=0, Step=floorheight, Count=floorcount)
series_2 = Series(Start=0, Step=floorcount_2, Count=floorcount)
ellipse = Ellipse(Plane=pt, Radius1=Slider(19, range=0..100), Radius2=Slider(38, range=0..100))  # -> Ellipse, Focus1, Focus2
rad = Radians(Degrees=series_2)
Z = UnitZ(Factor=series)
move = Move(Geometry=ellipse.Ellipse, Motion=Z)  # -> Geometry, Transform
rotate = Rotate(Geometry=move.Geometry, Angle=rad, Plane=PlaneXY(0, 0, 0))  # -> Geometry, Transform
boundary = BoundarySurfaces(Edges=rotate.Geometry)
Z_2 = UnitZ(Factor=floorheight)
extr = Extrude(Base=boundary, Direction=Z_2)
