# Grasshopper definition Python_ConstructPoint.gh (Grasshopper 1.0.7)

number_slider = Slider(0.208, range=0..1)
number_slider_2 = Slider(0.794, range=0..1)
number_slider_3 = Slider(0.18, range=0..1)
pt = ConstructPoint(XCoordinate=number_slider, YCoordinate=number_slider_2, ZCoordinate=number_slider_3)
const_point = GhPythonScript(X=number_slider, Y=number_slider_2, Z=number_slider_3)  # -> out, Pt
# ---------- const_point: Python ----------
import Rhino
Pt= Rhino.Geometry.Point3d(X,Y,Z)
print(Pt)
# ---------- end const_point ----------
panel = Panel(pt)
panel_2 = Panel(const_point.out)
panel_3 = Panel(const_point.Pt)

const_point_2 = GhPythonScript(X=Slider(0.208, range=0..1), Y=Slider(0.794, range=0..1), Z=Slider(0.18, range=0..1))  # -> out, Pt; same code as const_point
deconstructpoint_python = GhPythonScript(Pt=const_point_2.Pt)  # -> out, X, Y, Z; inputs Pt: Point3d
# ---------- deconstructpoint_python: Python ----------
import Rhino
X= Pt.X
Y= Pt.Y
Z= Pt.Z
# ---------- end deconstructpoint_python ----------
panel_4 = Panel(deconstructpoint_python.Z)
panel_5 = Panel(deconstructpoint_python.Y)
panel_6 = Panel(deconstructpoint_python.X)

const_point_3 = GhPythonScript(X=Slider(0.208, range=0..1), Y=Slider(0.794, range=0..1), Z=Slider(0.18, range=0..1))  # -> out, Pt; same code as const_point
const_point_4 = GhPythonScript(X=Slider(0.706, range=0..1), Y=Slider(0.3, range=0..1), Z=Slider(0.742, range=0..1))  # -> out, Pt; same code as const_point
python = GhPythonScript(A=const_point_3.Pt, B=const_point_4.Pt)  # -> out, L; inputs A: Point3d, B: Point3d
# ---------- python: Python ----------
import Rhino
L= Rhino.Geometry.Line(A,B)
print(L)
# ---------- end python ----------
panel_7 = Panel(python.out)
panel_8 = Panel(python.L)

length = Slider(21.32, range=0..50)
const_point_5 = GhPythonScript(X=Slider(0.87, range=0..1), Y=Slider(0.416, range=0..1), Z=Slider(0.261, range=0..1))  # -> out, Pt; same code as const_point
Z = UnitZ(Factor=1)
python_2 = GhPythonScript(S=const_point_5.Pt, L=length)  # -> out, L1; inputs S: Point3d, D: Vector3d
# ---------- python_2: Python ----------
import Rhino
D= Rhino.Geometry.Vector3d.ZAxis
L1= Rhino.Geometry.Line(S,D,L)
print(L1)
# ---------- end python_2 ----------
line = LineSDL(Start=const_point_5.Pt, Direction=Z, Length=length)
panel_9 = Panel(python_2.L1)
panel_10 = Panel(line)
