# Grasshopper definition SuperTreeGorve.gh (Grasshopper 1.0.7)

number_slider = Slider(20, range=0..100)
number_slider_2 = Slider(20, range=0..100)
curve = Curve(<curve referenced from the Rhino model>)
curve_2 = Curve(<curve referenced from the Rhino model>)
curve_3 = Curve(<curve referenced from the Rhino model>)
curve_4 = Curve(<curve referenced from the Rhino model>)
curve_5 = Curve(<curve referenced from the Rhino model>)
curve_6 = Curve(<curve referenced from the Rhino model>)
unit_z = UnitZ(Factor=Slider(67, range=0..100))
unit_z_2 = UnitZ(Factor=Slider(68, range=0..100))
number_slider_3 = Slider(20, range=0..100)
number_slider_4 = Slider(20, range=0..100)
curve_7 = Curve(<curve referenced from the Rhino model>)
curve_8 = Curve(<curve referenced from the Rhino model>)
curve_9 = Curve(<curve referenced from the Rhino model>)
curve_10 = Curve(<curve referenced from the Rhino model>)
curve_11 = Curve(<curve referenced from the Rhino model>)
curve_12 = Curve(<curve referenced from the Rhino model>)
unit_z_3 = UnitZ(Factor=Slider(68, range=0..100))
unit_z_4 = UnitZ(Factor=Slider(67, range=0..100))
move = Move(Geometry=curve_7, Motion=unit_z_3)  # -> Geometry, Transform
move_2 = Move(Geometry=curve_8, Motion=unit_z_4)  # -> Geometry, Transform
move_3 = Move(Geometry=curve_10, Motion=unit_z_2)  # -> Geometry, Transform
divide_curve = DivideCurve(Curve=curve, Count=number_slider, Kinks=False)  # -> Points, Tangents, Parameters
divide_curve_2 = DivideCurve(Curve=curve_2, Count=number_slider, Kinks=False)  # -> Points, Tangents, Parameters
divide_curve_3 = DivideCurve(Curve=curve_3, Count=number_slider, Kinks=False)  # -> Points, Tangents, Parameters
divide_curve_4 = DivideCurve(Curve=curve_4, Count=number_slider_2, Kinks=False)  # -> Points, Tangents, Parameters
divide_curve_5 = DivideCurve(Curve=curve_5, Count=number_slider_2, Kinks=False)  # -> Points, Tangents, Parameters
divide_curve_6 = DivideCurve(Curve=curve_6, Count=number_slider_2, Kinks=False)  # -> Points, Tangents, Parameters
move_4 = Move(Geometry=curve_11, Motion=unit_z)  # -> Geometry, Transform
divide_curve_7 = DivideCurve(Curve=curve_9, Count=number_slider_3, Kinks=False)  # -> Points, Tangents, Parameters
divide_curve_8 = DivideCurve(Curve=move.Geometry, Count=number_slider_3, Kinks=False)  # -> Points, Tangents, Parameters
divide_curve_9 = DivideCurve(Curve=move_2.Geometry, Count=number_slider_3, Kinks=False)  # -> Points, Tangents, Parameters
divide_curve_10 = DivideCurve(Curve=move_3.Geometry, Count=number_slider_4, Kinks=False)  # -> Points, Tangents, Parameters
divide_curve_11 = DivideCurve(Curve=move_4.Geometry, Count=number_slider_4, Kinks=False)  # -> Points, Tangents, Parameters
divide_curve_12 = DivideCurve(Curve=curve_12, Count=number_slider_4, Kinks=False)  # -> Points, Tangents, Parameters
shift_list = ShiftList(List=divide_curve_2.Points, Shift=Slider(4, range=0..10), Wrap=True)
shift_list_2 = ShiftList(List=divide_curve.Points, Shift=Slider(4, range=0..10), Wrap=True)
shift_list_3 = ShiftList(List=divide_curve_3.Points, Shift=Slider(5, range=0..10), Wrap=True)
shift_list_4 = ShiftList(List=divide_curve_5.Points, Shift=Slider(4, range=0..10), Wrap=True)
shift_list_5 = ShiftList(List=divide_curve_4.Points, Shift=Slider(2, range=0..10), Wrap=True)
shift_list_6 = ShiftList(List=divide_curve_6.Points, Shift=Slider(5, range=0..10), Wrap=True)
shift_list_7 = ShiftList(List=divide_curve_9.Points, Shift=Slider(4, range=0..10), Wrap=True)
shift_list_8 = ShiftList(List=divide_curve_8.Points, Shift=Slider(2, range=0..10), Wrap=True)
shift_list_9 = ShiftList(List=divide_curve_7.Points, Shift=Slider(5, range=0..10), Wrap=True)
shift_list_10 = ShiftList(List=divide_curve_11.Points, Shift=Slider(4, range=0..10), Wrap=True)
shift_list_11 = ShiftList(List=divide_curve_10.Points, Shift=Slider(4, range=0..10), Wrap=True)
shift_list_12 = ShiftList(List=divide_curve_12.Points, Shift=Slider(5, range=0..10), Wrap=True)
partition_list = PartitionList(List=[shift_list_2, shift_list, shift_list_3], Size=number_slider)
partition_list_2 = PartitionList(List=[shift_list_5, shift_list_4, shift_list_6], Size=number_slider_2)
flip_matrix = FlipMatrix(Data=partition_list)
flip_matrix_2 = FlipMatrix(Data=partition_list_2)
partition_list_3 = PartitionList(List=[shift_list_8, shift_list_7, shift_list_9], Size=number_slider_3)
partition_list_4 = PartitionList(List=[shift_list_11, shift_list_10, shift_list_12], Size=number_slider_4)
interpolate = Interpolate(Vertices=flip_matrix, Degree=3, Periodic=False, KnotStyle=1)  # -> Curve, Length, Domain
interpolate_2 = Interpolate(Vertices=flip_matrix_2, Degree=3, Periodic=False, KnotStyle=1)  # -> Curve, Length, Domain
flip_matrix_3 = FlipMatrix(Data=partition_list_3)
flip_matrix_4 = FlipMatrix(Data=partition_list_4)
curve_13 = Curve(interpolate.Curve)
curve_14 = Curve(interpolate_2.Curve)
interpolate_3 = Interpolate(Vertices=flip_matrix_3, Degree=3, Periodic=False, KnotStyle=1)  # -> Curve, Length, Domain
interpolate_4 = Interpolate(Vertices=flip_matrix_4, Degree=3, Periodic=False, KnotStyle=1)  # -> Curve, Length, Domain
relay = Relay()
relay_2 = Relay()
relay_3 = Relay()
curve_15 = Curve(interpolate_3.Curve)
curve_16 = Curve(interpolate_4.Curve)
merge = Merge(Data1=curve_13, Data2=curve_14, Data3=curve, Data4=curve_2, Data5=curve_3)
pipe = Pipe(Curve=merge, Radius=Slider(2, range=0.1..2), Caps=0)
merge_2 = Merge(Data1=curve_15, Data2=curve_16, Data3=move.Geometry, Data4=move_2.Geometry, Data5=curve_9)
unit_x = UnitX(Factor=Slider(552, range=0..1000))
pipe_2 = Pipe(Curve=merge_2, Radius=Slider(2, range=0.1..2), Caps=0)
move_5 = Move(Geometry=pipe_2, Motion=unit_x)  # -> Geometry, Transform
