# Grasshopper definition TreeD.gh (Grasshopper 1.0.7)

brep = Brep(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)
brep_2 = Brep(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)

brep_3 = Brep(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)
brep_4 = Brep(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)

brep_5 = Brep(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)
brep_6 = Brep(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)

rotation_jitter = Slider(166, range=0..360)
curve = Curve(<curve referenced from the Rhino model>)
spacing_btw_trees = Slider(9, range=0..100)
spacing_jitter = Slider(11, range=0..20)
path_jitter = Slider(50, range=0..100)
tree1 = Geometry(graft([brep_2, brep]))
tree2 = Geometry(graft([brep_5, brep_6]))
tree3 = Geometry(graft([brep_3, brep_4]))

treed = TreeD(
    curve=curve,
    spacingbtwtrees=spacing_btw_trees,
    spacingjitter=spacing_jitter,
    pathjitter=path_jitter,
    rotationjitter=rotation_jitter,
    trees=[tree1, tree2, tree3])
explode_tree = ExplodeTree(Data=treed)  # -> Branch0, Branch1
geometry = Geometry(explode_tree.Branch1)
geometry_2 = Geometry(explode_tree.Branch0)
custom_preview = CustomPreview(Geometry=geometry, Material=ColourSwatch(SwatchColor=RGB(114, 89, 77)))
custom_preview_2 = CustomPreview(Geometry=geometry_2, Material=ColourSwatch(SwatchColor=RGB(161, 237, 128)))
explode_tree_2 = ExplodeTree()  # -> Branch0, Branch1
explode_tree_3 = ExplodeTree()  # -> Branch0, Branch1
explode_tree_4 = ExplodeTree()  # -> Branch0, Branch1
explode_tree_5 = ExplodeTree()  # -> Branch0, Branch1
explode_tree_6 = ExplodeTree()  # -> Branch0, Branch1
explode_tree_7 = ExplodeTree()  # -> Branch0, Branch1
explode_tree_8 = ExplodeTree()  # -> Branch0, Branch1
explode_tree_9 = ExplodeTree()  # -> Branch0, Branch1
explode_tree_10 = ExplodeTree()  # -> Branch0, Branch1
explode_tree_11 = ExplodeTree()  # -> Branch0, Branch1
explode_tree_12 = ExplodeTree()  # -> Branch0, Branch1
explode_tree_13 = ExplodeTree()  # -> Branch0, Branch1
explode_tree_14 = ExplodeTree()  # -> Branch0, Branch1
explode_tree_15 = ExplodeTree()  # -> Branch0, Branch1
explode_tree_16 = ExplodeTree()  # -> Branch0, Branch1
explode_tree_17 = ExplodeTree()  # -> Branch0, Branch1
explode_tree_18 = ExplodeTree()  # -> Branch0, Branch1
explode_tree_19 = ExplodeTree()  # -> Branch0, Branch1
explode_tree_20 = ExplodeTree()  # -> Branch0, Branch1
explode_tree_21 = ExplodeTree()  # -> Branch0, Branch1
explode_tree_22 = ExplodeTree()  # -> Branch0, Branch1
explode_tree_23 = ExplodeTree()  # -> Branch0, Branch1
geometry_3 = Geometry(explode_tree_2.Branch1)
geometry_4 = Geometry(explode_tree_3.Branch1)
geometry_5 = Geometry(explode_tree_4.Branch1)
geometry_6 = Geometry(explode_tree_5.Branch1)
geometry_7 = Geometry(explode_tree_6.Branch1)
geometry_8 = Geometry(explode_tree_7.Branch1)
geometry_9 = Geometry(explode_tree_9.Branch0)
geometry_10 = Geometry(explode_tree_10.Branch0)
geometry_11 = Geometry(explode_tree_8.Branch1)
geometry_12 = Geometry(explode_tree_12.Branch0)
geometry_13 = Geometry(explode_tree_13.Branch0)
geometry_14 = Geometry(explode_tree_9.Branch1)
geometry_15 = Geometry(explode_tree_10.Branch1)
geometry_16 = Geometry(explode_tree_11.Branch1)
geometry_17 = Geometry(explode_tree_15.Branch0)
geometry_18 = Geometry(explode_tree_16.Branch0)
geometry_19 = Geometry(explode_tree_12.Branch1)
geometry_20 = Geometry(explode_tree_13.Branch1)
geometry_21 = Geometry(explode_tree_14.Branch1)
geometry_22 = Geometry(explode_tree_18.Branch0)
geometry_23 = Geometry(explode_tree_19.Branch0)
geometry_24 = Geometry(explode_tree_15.Branch1)
geometry_25 = Geometry(explode_tree_16.Branch1)
geometry_26 = Geometry(explode_tree_17.Branch1)
geometry_27 = Geometry(explode_tree_20.Branch0)
geometry_28 = Geometry(explode_tree_21.Branch0)
geometry_29 = Geometry(explode_tree_18.Branch1)
geometry_30 = Geometry(explode_tree_19.Branch1)
geometry_31 = Geometry(explode_tree_22.Branch0)
geometry_32 = Geometry(explode_tree_23.Branch0)
geometry_33 = Geometry(explode_tree_20.Branch1)
geometry_34 = Geometry(explode_tree_21.Branch1)
geometry_35 = Geometry(explode_tree_22.Branch1)
geometry_36 = Geometry(explode_tree_23.Branch1)
custom_preview_3 = CustomPreview(Geometry=geometry_3, Material=ColourSwatch(SwatchColor=RGB(129, 126, 56)))
custom_preview_4 = CustomPreview(Geometry=geometry_4, Material=ColourSwatch(SwatchColor=RGB(129, 126, 56)))
custom_preview_5 = CustomPreview(Material=ColourSwatch(SwatchColor=RGB(137, 227, 111)))
custom_preview_6 = CustomPreview(Material=ColourSwatch(SwatchColor=RGB(137, 227, 111)))
custom_preview_7 = CustomPreview(Geometry=geometry_5, Material=ColourSwatch(SwatchColor=RGB(129, 126, 56)))
custom_preview_8 = CustomPreview(Geometry=geometry_6, Material=ColourSwatch(SwatchColor=RGB(129, 126, 56)))
custom_preview_9 = CustomPreview(Material=ColourSwatch(SwatchColor=RGB(137, 227, 111)))
custom_preview_10 = CustomPreview(Material=ColourSwatch(SwatchColor=RGB(137, 227, 111)))
custom_preview_11 = CustomPreview(Geometry=geometry_7, Material=ColourSwatch(SwatchColor=RGB(129, 126, 56)))
custom_preview_12 = CustomPreview(Material=ColourSwatch(SwatchColor=RGB(137, 227, 111)))
custom_preview_13 = CustomPreview(Geometry=geometry_8, Material=ColourSwatch(SwatchColor=RGB(129, 126, 56)))
custom_preview_14 = CustomPreview(Material=ColourSwatch(SwatchColor=RGB(137, 227, 111)))
custom_preview_15 = CustomPreview(Geometry=geometry_11, Material=ColourSwatch(SwatchColor=RGB(129, 126, 56)))
custom_preview_16 = CustomPreview(Material=ColourSwatch(SwatchColor=RGB(137, 227, 111)))
custom_preview_17 = CustomPreview(Geometry=geometry_14, Material=ColourSwatch(SwatchColor=RGB(129, 126, 56)))
custom_preview_18 = CustomPreview(Geometry=geometry_15, Material=ColourSwatch(SwatchColor=RGB(129, 126, 56)))
custom_preview_19 = CustomPreview(Geometry=geometry_9, Material=ColourSwatch(SwatchColor=RGB(137, 227, 111)))
custom_preview_20 = CustomPreview(Geometry=geometry_10, Material=ColourSwatch(SwatchColor=RGB(137, 227, 111)))
custom_preview_21 = CustomPreview(Geometry=geometry_16, Material=ColourSwatch(SwatchColor=RGB(129, 126, 56)))
custom_preview_22 = CustomPreview(Material=ColourSwatch(SwatchColor=RGB(137, 227, 111)))
custom_preview_23 = CustomPreview(Geometry=geometry_19, Material=ColourSwatch(SwatchColor=RGB(129, 126, 56)))
custom_preview_24 = CustomPreview(Geometry=geometry_20, Material=ColourSwatch(SwatchColor=RGB(129, 126, 56)))
custom_preview_25 = CustomPreview(Geometry=geometry_12, Material=ColourSwatch(SwatchColor=RGB(137, 227, 111)))
custom_preview_26 = CustomPreview(Geometry=geometry_13, Material=ColourSwatch(SwatchColor=RGB(137, 227, 111)))
custom_preview_27 = CustomPreview(Geometry=geometry_21, Material=ColourSwatch(SwatchColor=RGB(129, 126, 56)))
custom_preview_28 = CustomPreview(Material=ColourSwatch(SwatchColor=RGB(137, 227, 111)))
custom_preview_29 = CustomPreview(Geometry=geometry_24, Material=ColourSwatch(SwatchColor=RGB(129, 126, 56)))
custom_preview_30 = CustomPreview(Geometry=geometry_25, Material=ColourSwatch(SwatchColor=RGB(129, 126, 56)))
custom_preview_31 = CustomPreview(Geometry=geometry_17, Material=ColourSwatch(SwatchColor=RGB(137, 227, 111)))
custom_preview_32 = CustomPreview(Geometry=geometry_18, Material=ColourSwatch(SwatchColor=RGB(137, 227, 111)))
custom_preview_33 = CustomPreview(Geometry=geometry_26, Material=ColourSwatch(SwatchColor=RGB(129, 126, 56)))
custom_preview_34 = CustomPreview(Material=ColourSwatch(SwatchColor=RGB(137, 227, 111)))
custom_preview_35 = CustomPreview(Geometry=geometry_29, Material=ColourSwatch(SwatchColor=RGB(129, 126, 56)))
custom_preview_36 = CustomPreview(Geometry=geometry_30, Material=ColourSwatch(SwatchColor=RGB(129, 126, 56)))
custom_preview_37 = CustomPreview(Geometry=geometry_22, Material=ColourSwatch(SwatchColor=RGB(137, 227, 111)))
custom_preview_38 = CustomPreview(Geometry=geometry_23, Material=ColourSwatch(SwatchColor=RGB(137, 227, 111)))
custom_preview_39 = CustomPreview(Geometry=geometry_33, Material=ColourSwatch(SwatchColor=RGB(129, 126, 56)))
custom_preview_40 = CustomPreview(Geometry=geometry_34, Material=ColourSwatch(SwatchColor=RGB(129, 126, 56)))
custom_preview_41 = CustomPreview(Geometry=geometry_27, Material=ColourSwatch(SwatchColor=RGB(137, 227, 111)))
custom_preview_42 = CustomPreview(Geometry=geometry_28, Material=ColourSwatch(SwatchColor=RGB(137, 227, 111)))
custom_preview_43 = CustomPreview(Geometry=geometry_35, Material=ColourSwatch(SwatchColor=RGB(129, 126, 56)))
custom_preview_44 = CustomPreview(Geometry=geometry_36, Material=ColourSwatch(SwatchColor=RGB(129, 126, 56)))
custom_preview_45 = CustomPreview(Geometry=geometry_31, Material=ColourSwatch(SwatchColor=RGB(137, 227, 111)))
custom_preview_46 = CustomPreview(Geometry=geometry_32, Material=ColourSwatch(SwatchColor=RGB(137, 227, 111)))

# ==== cluster TreeD: Creates Trees and Landscape along defined path.
pathjitter = ClusterInput()
rotationjitter = ClusterInput()
spacingjitter = ClusterInput()
trees = ClusterInput()  # Geometry of the Trees/Planation
spacingbtwtrees = ClusterInput()
curve = ClusterInput()

# ---- group: SPACING JITTER
length = Length(Curve=curve)
construct_domain = ConstructDomain(DomainStart=expr("-X", spacingjitter), DomainEnd=spacingjitter)
integer_division = IntegerDivision(A=length, B=spacingbtwtrees)
divide_curve = DivideCurve(Curve=curve, Count=integer_division, Kinks=False)  # -> Points, Tangents, Parameters
random = Random(Range=construct_domain, Number=expr("X+1", integer_division), Seed=2, Integers=True)
multiplication = Multiplication(A=divide_curve.Tangents, B=random)
perp_frame = PerpFrame(Curve=curve, Parameter=divide_curve.Parameters)
deconstruct_plane = DeconstructPlane(Plane=perp_frame)  # -> Origin, XAxis, YAxis, ZAxis
construct_plane = ConstructPlane(Origin=deconstruct_plane.Origin, XAxis=deconstruct_plane.XAxis, YAxis=deconstruct_plane.ZAxis)
move = Move(Geometry=construct_plane, Motion=multiplication)  # -> Geometry, Transform

# ---- group: Path Jitter
construct_domain_2 = ConstructDomain(DomainStart=expr("-X", pathjitter), DomainEnd=pathjitter)
random_2 = Random(Range=construct_domain_2, Number=expr("X+1", integer_division), Seed=2, Integers=True)
unit_z = UnitZ(Factor=1)
cross_product = CrossProduct(VectorA=divide_curve.Tangents, VectorB=unit_z, Unitize=False)  # -> Vector, Length
multiplication_2 = Multiplication(A=cross_product.Vector, B=random_2)
move_2 = Move(Geometry=move.Geometry, Motion=multiplication_2)  # -> Geometry, Transform

# ---- group: Rotation Jitter
construct_domain_3 = ConstructDomain(DomainStart=expr("-X", rotationjitter), DomainEnd=rotationjitter)
random_3 = Random(Range=construct_domain_3, Number=integer_division, Seed=2, Integers=True)
deconstruct_plane_2 = DeconstructPlane(Plane=move_2.Geometry)  # -> Origin, XAxis, YAxis, ZAxis
radians = Radians(Degrees=random_3)
rotate = Rotate(Geometry=move_2.Geometry, Angle=radians, Plane=deconstruct_plane_2.Origin)  # -> Geometry, Transform

# ---- group: Placing Geometry on Path
list_length = ListLength(List=rotate.Geometry)
value_list = ValueList({"Square": 0, "Ball": 1, "Round": 2}, selected=["Square", "Ball", "Round"])
list_length_2 = ListLength(List=value_list)  # -> expr("x-1", Length)
random_4 = Random(Range=list_length_2, Number=list_length, Seed="0", Integers=True)
list_item = ListItem(List=trees, Index=random_4, Wrap=True)
orient = Orient(Geometry=list_item, Source=PlaneXY(0, 0, 0), Target=rotate.Geometry)  # -> Geometry, Transform

# ----
explode_tree = ExplodeTree()  # -> Branch0, Branch1
geometry = Geometry(explode_tree.Branch0)
geometry_2 = Geometry(explode_tree.Branch1)
trees_2 = ClusterOutput(orient.Geometry)
custom_preview = CustomPreview(Geometry=geometry_2, Material=ColourSwatch(SwatchColor=RGB(129, 126, 56)))
custom_preview_2 = CustomPreview(Geometry=geometry, Material=ColourSwatch(SwatchColor=RGB(137, 227, 111)))
